# Grasshopper definition rammeprogram.gh (Grasshopper 0.9.76)
# plug-ins: Python Interpreter

# ---- group: Cluster Indhold
explode = Explode(Recursive=True)  # -> Segments, Vertices; disabled
eval = EvaluateCurve(Curve=reparameterize(explode.Segments), Parameter=0.5)  # -> Point, Tangent, Angle; disabled
sort_pt = SortPoints(Points=flatten(eval.Point))  # -> Points, Indices; disabled
tstat = TreeStatistics(Tree=eval.Point)  # -> Paths, Length, Count; disabled
item = ListItem(List=tstat.Paths, Index=sort_pt.Indices, Wrap=True)  # disabled
branch = TreeBranch(Tree=explode.Segments, Path=item, MaintainPaths=False)  # disabled
explode_2 = Explode(Curve=branch, Recursive=True)  # -> Segments, Vertices; disabled
sort_pt_2 = SortPoints(Points=flatten(explode_2.Vertices))  # -> Points, Indices; disabled
pdecon = Deconstruct(Point=sort_pt_2.Points)  # -> XComponent, YComponent, ZComponent; disabled
pt = ConstructPoint(XCoordinate=pdecon.XComponent, YCoordinate=pdecon.YComponent, ZCoordinate=0)  # disabled
bbox = BoundingBox(Content=pt, Plane=PlaneXY(0, 0, 0), UnionBox=True)  # -> Box, Box_2; disabled
area = Area(Geometry=bbox.Box)  # -> Area, Centroid; disabled
division = Division(A=area.Area, B=1500)  # disabled
cullpt = CullDuplicates(Points=pt, Tolerance=0.1, CullMode=3)  # -> Points, Indices, Valence; disabled
cp = ClosestPoint(Point=explode_2.Vertices, Cloud=cullpt.Points)  # -> ClosestPoint, CPIndex, Distance; disabled
eval_2 = EvaluateCurve(Curve=reparameterize(flatten(explode_2.Segments)), Parameter=0.5)  # -> Point, Tangent, Angle; disabled
item_2 = ListItem(List=cp.CPIndex, Index=0, Wrap=True)  # -> Item, Item1; disabled
points = PointList(Points=cullpt.Points, Size=division)  # disabled
points_2 = PointList(Points=eval_2.Point, Size=division)  # disabled
pt_2 = ConstructPoint(XCoordinate=item_2.Item, YCoordinate=item_2.Item1, ZCoordinate=0)  # -> flatten(Point); disabled

# ----
number_slider = Slider(0.25, range=0..10)
crv = Curve([<curve referenced from the Rhino model> x5])
crv_2 = Curve([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])
crv_3 = Curve([<curve referenced from the Rhino model> x5])

# ----
# OLD
cluster = Cluster(C=crv_3)  # -> nodes, topolist; disabled
panel = Panel("""0,1,0
1,2,0
2,3,0
3,4,0
4,5,0
5,6,0
6,7,0
7,8,0
8,9,0
9,10,0
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""")  # disabled
panel_2 = Panel("""0,20
10,20
20,20
30,20
40,20
50,20
60,20
70,20
80,20
90,20
100,20
110,20
120,20
0,0
10,5.23
20,9.51
30,12.84
40,15.21
50,16.64
60,17.12
70,16.64
80,15.21
90,12.84
100,9.51
110,5.23
120,0""")  # disabled
pt_3 = Point(panel)  # disabled
pt_4 = Point(panel_2)  # disabled
panel_3 = Panel("""     14 11
14 2 0
                      14 6 0
                      26 1 0
                      26 2 0
                      1 2 0
                      7 1 0
                      13 2 0""")  # disabled
pdecon_2 = Deconstruct(Point=panel)  # -> XComponent, YComponent, ZComponent; disabled
lng = ListLength(List=cluster.nodes)  # disabled
int = Integer(pdecon_2.XComponent)  # disabled
int_2 = Integer(pdecon_2.YComponent)  # disabled
number_slider_2 = Slider(2, range=0..10)  # disabled
series = Series(Start=0, Step=1, Count=lng)  # disabled
lng_2 = ListLength(List=pt_4)  # disabled
xy = XYPlane(Origin=pt_4)  # disabled
bbox_2 = BoundingBox(Content=pt_4, Plane=PlaneXY(0, 0, 0), UnionBox=True)  # -> Box, Box_2; disabled
int_3 = Integer(series)  # disabled
item_3 = ListItem(List=pt_4, Index=int, Wrap=True)  # disabled
item_4 = ListItem(List=pt_4, Index=int_2, Wrap=True)  # disabled
python = PythonScript(topolist=pt_3, nodes=pt_4)  # -> out, elements; inputs topolist: list, nodes: list; disabled
# ---------- python: Python ----------
import rhinoscriptsyntax as rs
import scriptcontext
import Rhino
scriptcontext.doc = ghdoc
startpoint=[]
endpoint=[]
eleProp=[]
elements=[]

for topo in topolist:
    indices=str(rs.PointCoordinates(topo)).split(",")
    stpt=nodes[int(indices[0])]
    enpt=nodes[int(indices[1])]
    startpoint.append(stpt)
    endpoint.append(enpt)
    elements.append(rs.AddLine(stpt,enpt))
    #eleProp.append(nodes[indices[2]])
# ---------- end python ----------
series_2 = Series(Start=0, Step=1, Count=lng_2)  # disabled
crv_4 = Curve(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)  # disabled
crv_5 = Curve(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)  # disabled
crv_6 = Curve(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)  # disabled
python_2 = PythonScript()  # -> out, elements; inputs topolist: list, nodes: list; disabled; same code as python
pt_5 = Point(cluster.nodes)  # disabled
area_2 = Area(Geometry=bbox_2.Box)  # -> Area, Centroid; disabled
series_3 = Series(Start=0, Step=1, Count=10)  # disabled
ln = Line(StartPoint=item_3, EndPoint=item_4)  # disabled
python_3 = PythonScript(points=pt_5, height=number_slider_2)  # -> out, numbering; inputs points: list of Point3d; disabled
# ---------- python_3: Python ----------
import rhinoscriptsyntax as rs
import scriptcontext as sc
import Rhino as r
rs.EnableRedraw(False)
plane=[]
for pt in points:
    plane.append(rs.MovePlane(rs.WorldXYPlane(),pt))

sc.doc = r.RhinoDoc.ActiveDoc

numbering =[]
for i in range(len(plane)):
    preText = rs.AddText(str(i), plane[i], height)
    textGeo = rs.ExplodeText(preText, True)
    
    for i in textGeo:
        numbering.append(rs.coercegeometry(i))
        rs.DeleteObject(i)
sc.doc = ghdoc
rs.EnableRedraw(True)
# ---------- end python_3 ----------
merge = Merge(Data1=crv_4, Data2=crv_5, Data3=crv_6)  # disabled
panel_4 = Panel("""14,1
14,2
14,3
26,1
26,2
1,2
7,1
13,2""")  # disabled
int_4 = Integer(series_2)  # disabled
division_2 = Division(A=area_2.Area, B=1000)  # disabled
scale = Scale(Geometry=merge, Center=Point(0, 0, 0), Factor=division_2)  # -> Geometry, Transform; disabled
tag = TextTag3D(Location=pt_4, Text=int_4, Size=division_2, Justification=7)  # disabled
panel_5 = Panel(python_2.elements)  # disabled

number_slider_3 = Slider(4, range=0..10)

# ---- group: ElementTopology
python_4 = PythonScript(incurves=crv_2, sortEle=Toggle(True), sortNod=Toggle(True))  # -> nodes, elements, ElePlanes, StartIndex, EndIndex, NodeDOFS, EleNum, NodNum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; inputs incurves: list
# ---------- python_4: Python ----------
import rhinoscriptsyntax as rs
import scriptcontext as sc
import Rhino as rh
import math
#Deactivate preview for ElePlanes and Nodes
ghenv.Component.Params.Output[0].Hidden = True
ghenv.Component.Params.Output[2].Hidden = True

#sc.doc = ghdoc
def SortCurvesMid(curves):
    points=[]
    indices=[]
    
    for curve in curves:
        points.append(rs.CurveMidPoint(curve))
    sortedpts=rs.SortPoints(points,True)
    for point in points:
        indices.append(sortedpts.index(point))
    sortin,sortLines = zip(*sorted(zip(indices, curves)))
    return sortLines
def SafeExplodeCrv(inCurves):
    curves=[]
    
    for crv in inCurves:
        if rs.IsPolyline(crv) or rs.IsPolyCurve(crv):
            curves.extend(rs.ExplodeCurves(crv))
        else:
            curves.append(crv)
    return curves
def SortEndPtsUnique(lines):
    sortPts=[]
    lines2=[]
    for line in lines:
        stPt=rs.AddPoint(round(rs.CurveStartPoint(line)[0],3),round(rs.CurveStartPoint(line)[1],3),0)
        enPt=rs.AddPoint(round(rs.CurveEndPoint(line)[0],3),round(rs.CurveEndPoint(line)[1],3),0)
        endPts=[rs.coerce3dpoint(stPt),rs.coerce3dpoint(enPt)]
        endPts=rs.SortPoints(endPts)
        lines2.append(rs.AddLine(endPts[0],endPts[1]))
        for endPt in endPts:
            if sortPts.count(endPt)==0:
                sortPts.append(endPt)
    return sortPts, lines2
def EndPtsUnique(lines):
    pts=[]
    for line in lines:
        stPt=rs.AddPoint(round(rs.CurveStartPoint(line)[0],3),round(rs.CurveStartPoint(line)[1],3),0)
        enPt=rs.AddPoint(round(rs.CurveEndPoint(line)[0],3),round(rs.CurveEndPoint(line)[1],3),0)
        endPts=[rs.coerce3dpoint(stPt),rs.coerce3dpoint(enPt)]
        for endPt in endPts:
            if pts.count(endPt)==0:
                pts.append(endPt)
    return pts
def TextPreview(basepoints,preString):
    rs.EnableRedraw(False)
    plane=[]
    for pt in basepoints:
        plane.append(rs.MovePlane(rs.WorldXYPlane(),pt))
    
    sc.doc = rh.RhinoDoc.ActiveDoc
    
    numbering =[]
    for i in range(len(plane)):
        preText = rs.AddText(str(preString[i]), plane[i], 0.25*(1/rs.UnitScale(4)),justification=131074)
        textGeo = rs.ExplodeText(preText, True)
        for i in textGeo:
            numbering.append(rs.coercegeometry(i))
            rs.DeleteObject(i)
    sc.doc = ghdoc
    rs.EnableRedraw(True)
    return numbering

curves=SafeExplodeCrv(incurves)

elements=[]
nodes=[]
for curve in curves:
    elements.append(rs.AddLine(rs.CurveStartPoint(curve),rs.CurveEndPoint(curve)))

if sortEle:
    elements=SortCurvesMid(elements)
if sortNod:
    nodes,elements=SortEndPtsUnique(elements)
else:
    nodes=EndPtsUnique(elements)

StartIndex=[]
EndIndex=[]
for element in elements:
    StartIndex.append(rs.PointArrayClosestPoint(nodes, rs.CurveStartPoint(element)))
    EndIndex.append(rs.PointArrayClosestPoint(nodes, rs.CurveEndPoint(element)))

#Preview numbering
midpoints=[rs.CurveMidPoint(element) for element in elements]
EleNum=TextPreview(midpoints,range(len(midpoints)))
NodNum=TextPreview(nodes,range(len(nodes)))

#Scale Nodes to Meter
for repI, node in enumerate(nodes):
    nodes[repI]=node*rs.UnitScale(4)

ElePlanes=[]
for i in range(len(StartIndex)):
    xVector=rs.VectorUnitize(rs.VectorCreate(nodes[EndIndex[i]],nodes[StartIndex[i]]))
    ElePlanes.append(rs.PlaneFromNormal(nodes[StartIndex[i]],(0,0,1),xVector))

#To MatLab text
i=1
MatLabNodes=""
for node in nodes:
    X,Y,Z = node
    nodesString= "X("+str(i)+",:) = ["+str(X)+" "+str(Y)+"];"
    MatLabNodes=MatLabNodes+nodesString+"\n"
    i+=1
MatLabNodes=MatLabNodes+"nno="+str(i-1)+";"

i=1
MatLabElements=""
ESI=StartIndex
EEI=EndIndex
for j in range(len(ESI)):
    elementString= "T("+str(i)+",:) = ["+str(ESI[j]+1)+" "+str(EEI[j]+1)+"];"
    MatLabElements=MatLabElements+elementString+"\n"
    i+=1
MatLabElements=MatLabElements+"nel="+str(i-1)+";"


ESI=StartIndex
EEI=EndIndex
nodecount=max(ESI+EEI)-min(ESI+EEI)+1
dofcount=nodecount*3

uninodes=[]
doflist=[]
DOFSlist=[]
rngstart=1
#Define no-hinge DOFS
for i in range(len(ESI)):
    if uninodes.count(ESI[i])==0:
        uninodes.append(ESI[i])
        dofstart=range(rngstart,rngstart+3)
        doflist.append(dofstart)
        rngstart=rngstart+3
    else:
        dofstart=doflist[uninodes.index(ESI[i])]
    
    if uninodes.count(EEI[i])==0:
        uninodes.append(EEI[i])
        dofend=range(rngstart,rngstart+3)
        doflist.append(dofend)
        rngstart=rngstart+3
    else:
        dofend=doflist[uninodes.index(EEI[i])]
    DOFS=dofstart+dofend
    DOFSlist.append(DOFS)

DOFSflat = [item for sublist in DOFSlist for item in sublist]

DegreesOfFreedom=[]
for defree in DOFSlist:
    DegreesOfFreedom.append(str(defree))

MatLabDOFS=""
for k, dofree in enumerate(DegreesOfFreedom):
    MatLabDOF= "D("+str(k+1)+",:)="+ dofree.replace(",","")+";\n"
    MatLabDOFS=MatLabDOFS+MatLabDOF
MatLabDOFS=MatLabDOFS+"nd="+str(max(DOFSflat))+";"

NodeDOFS=[]
for nodeNo in range(max(max(ESI),max(EEI))+1):
    for l,sdof in enumerate(DOFSlist):
        if nodeNo == ESI[l]:
            NodeDOFS.append(sdof[:3])
            break
        elif nodeNo ==EEI[l]:
            NodeDOFS.append(sdof[3:])
            break
NodeDOFS=str(NodeDOFS)
# ---------- end python_4 ----------

# ----
int_5 = Integer([Slider(2, range=0..10), Slider(4, range=0..10)])

# ---- group: AddHinge
python_5 = PythonScript(
    NodeDOFS=python_4.NodeDOFS,
    ElementStartIndex=python_4.StartIndex,
    ElementEndIndex=python_4.EndIndex,
    AddHingeNode=int_5,
    AddHingeElement=Slider(1, range=0..10))  # -> DegreesOfFreedom, NodeDOFS, MatLabDOFS; inputs ElementStartIndex: list of Int32, ElementEndIndex: list of Int32, AddHingeNode: list of Int32, AddHingeElement: list
# ---------- python_5: Python ----------
import rhinoscriptsyntax as rs
ESI=ElementStartIndex
EEI=ElementEndIndex
AHE=AddHingeElement
AHN=AddHingeNode
#Repeat last element of shortest list
if len(AHE)<>0 and len(AHN)<>0:
    maxlen = max(len(AHE),len(AHN))
    AHE.extend([AHE[-1]]*(maxlen-len(AHE)))
    AHN.extend([AHN[-1]]*(maxlen-len(AHN)))

NodeDOFS=NodeDOFS.replace("[[","").replace("]]","").split("], [")
DOFSlist=[]
for i in range(len(ESI)):
    DOFSlist.append(map(int,NodeDOFS[ESI[i]].split(","))+map(int,NodeDOFS[EEI[i]].split(",")))

DOFSflat = [item for sublist in DOFSlist for item in sublist]

if len(AHN)<>0:
    #Add position of hinge
    for j in range(len(DOFSlist)):
        if len(AHE) == 0:
            for ahn in AHN:
                if ESI[j]==ahn:
                    DOFSlist[j][2]=0
                if EEI[j]==ahn:
                    DOFSlist[j][5]=0
        else:
            for ahe in AHE:
                if ahe==j:
                    for ahn in AHN:
                        if ESI[j]==ahn:
                            DOFSlist[j][2]=0
                        if EEI[j]==ahn:
                            DOFSlist[j][5]=0
    DOFSflat = [item for sublist in DOFSlist for item in sublist]
    print DOFSflat
    #Add hinge
    indices = [b for b, a in enumerate(DOFSflat) if a == 0]
    lowest =[c+1 for c in range(len(DOFSflat)) if DOFSflat.count(c+1)==0]
    print lowest
    for lowI,indi in enumerate(indices):
        DOFSflat[indi]=lowest[lowI]
    print DOFSflat
    newDOFSLIST=[]
    templist=[]
    for dofs in DOFSflat:
        templist.append(dofs)
        if len(templist)==6:
            newDOFSLIST.append(templist)
            templist=[]
    DOFSlist = newDOFSLIST
DegreesOfFreedom=[]
for defree in DOFSlist:
    DegreesOfFreedom.append(str(defree))

MatLabDOFS=""
for k, dofree in enumerate(DegreesOfFreedom):
    MatLabDOF= "D("+str(k+1)+",:)="+ dofree.replace(",","")+";\n"
    MatLabDOFS=MatLabDOFS+MatLabDOF
MatLabDOFS=MatLabDOFS+"nd="+str(max(DOFSflat))+";"

print DOFSlist
NodeDOFS=[]
for nodeNo in range(max(max(ESI),max(EEI))+1):
    for l,sdof in enumerate(DOFSlist):
        if nodeNo == ESI[l]:
            NodeDOFS.append(sdof[:3])
            break
        elif nodeNo ==EEI[l]:
            NodeDOFS.append(sdof[3:])
            break
NodeDOFS=str(NodeDOFS)
# ---------- end python_5 ----------

# ----
lng_3 = ListLength(List=python_4.elements)
python_6 = PythonScript()  # -> MatLabNodes, MatLabElements; inputs nodes: list, ElementStartIndex: list, ElementEndIndex: list; disabled
# ---------- python_6: Python ----------
import rhinoscriptsyntax as rs
i=1
MatLabNodes=""
for node in nodes:
    X,Y,Z = rs.PointCoordinates(node)
    nodesString= "X("+str(i)+",:) = ["+str(X)+" "+str(Y)+"];"
    MatLabNodes=MatLabNodes+nodesString+"\n"
    i+=1
MatLabNodes=MatLabNodes+"nno="+str(i-1)+";"

i=1
MatLabElements=""
ESI=ElementStartIndex
EEI=ElementEndIndex
for j in range(len(ElementStartIndex)):
    elementString= "T("+str(i)+",:) = ["+str(ESI[j]+1)+" "+str(EEI[j]+1)+"];"
    MatLabElements=MatLabElements+elementString+"\n"
    i+=1
MatLabElements=MatLabElements+"nel="+str(i-1)+";"
# ---------- end python_6 ----------
expression = Expression(x=Slider(2.1, range=0..10), Expression="x*10^11")
X = UnitX(Factor=1)
series_4 = Series(Start=0, Step=1, Count=lng_3)
Y = UnitY(Factor=1)
Z = UnitZ(Factor=1)
number_slider_4 = Slider(2, range=0..10)
number_slider_5 = Slider(52432, range=0..100000)
number_slider_6 = Slider(20000, range=0..100000)
rev = Reverse(Vector=Y)
int_6 = Integer(series_4)
num = Number(expression)
num_2 = Number([Slider(0.001, range=0..0.001), Slider(0.002, range=0..1)])
num_3 = Number(Slider(2e-06, range=0..1e-05))
toggle = BooleanToggle(True)
toggle_2 = BooleanToggle(True)
toggle_3 = BooleanToggle(True)
neg = Negative(Value=Slider(11, range=0..100))
python_7 = PythonScript(LoadNodesNo=Slider(1, range=0..1), NodeDOFS=python_5.NodeDOFS, Direction=X, Newton=Slider(20000, range=0..100000))  # -> out, MatLabNodeLoads; inputs LoadNodesNo: list, Direction: list, Newton: list
# ---------- python_7: Python ----------
import rhinoscriptsyntax as rs
LNN=LoadNodesNo
listDOFS=NodeDOFS.replace("[","").replace("]","").replace(" ","").split(",")
if len(LNN)==0 or len(Direction)==0 or len(Newton)==0:
    MatLabNodeLoad="bL = [];"
else:
    #Repeat last element of shortest list
    nodeLen = len(LNN)
    Direction.extend([Direction[-1]]*(nodeLen-len(Direction)))
    Newton.extend([Newton[-1]]*(nodeLen-len(Newton)))
    Direction=Direction[:nodeLen]
    Newton=Newton[:nodeLen]
    
    vecX=[]
    vecY=[]
    for dir in Direction:
        #Unitize 2D vector
        vec=rs.VectorUnitize([dir[0],dir[1],0])
        vecX.append(vec[0])
        vecY.append(vec[1])
    
    MatLabNodeLoads=""
    j=1
    for i,lnn in enumerate(LNN):
        xstring= "bL("+str(j)+",:)=["+str(listDOFS[int(lnn)*3])+" "+str(Newton[i]*vecX[i])+"];\n"
        j+=1
        ystring= "bL("+str(j)+",:)=["+str(listDOFS[int(lnn)*3+1])+" "+str(Newton[i]*vecY[i])+"];\n"
        j+=1
        MatLabNodeLoads=MatLabNodeLoads+xstring+ystring
# ---------- end python_7 ----------
vec = VectorXYZ(XComponent=0, YComponent=neg, ZComponent=0)  # -> Vector, Length
python_8 = PythonScript(ElementNo=int_6, Emodul=num, SecArea=num_2, Inertia=num_3)  # -> out, materials, MatLabMaterial; inputs ElementNo: list of Int32, Emodul: list, SecArea: list, Inertia: list
# ---------- python_8: Python ----------
if not (len(Emodul)==0 or len(SecArea)==0 or len(Inertia)==0 or len(ElementNo)==0):
    #Repeat last element in list to get equal list lenght
    maxlen = len(ElementNo)
    SecArea.extend([SecArea[-1]]*(maxlen-len(SecArea)))
    Emodul.extend([Emodul[-1]]*(maxlen-len(Emodul)))
    Inertia.extend([Inertia[-1]]*(maxlen-len(Inertia)))
    SecArea=SecArea[:maxlen]
    Emodul=Emodul[:maxlen]
    Inertia=Inertia[:maxlen]
    
    MatLabMaterial=""
    materials=[]
    for i in range(maxlen):
        mate="G("+str(ElementNo[i]+1)+",:)=["+str(Emodul[i])+" "+str(SecArea[i])+" "+str(Inertia[i])+"];"
        materials.append("E-module="+str(Emodul[i])+" Area="+str(SecArea[i])+" Inertia="+str(Inertia[i]))
        MatLabMaterial=MatLabMaterial+mate+"\n"
else:
    print "Zero length lists do NOT work"
# ---------- end python_8 ----------
python_9 = PythonScript(
    LoadElementNo=[Slider(1, range=0..1), Slider(3, range=0..10)],
    ElePlanes=python_4.ElePlanes,
    Direction=vec.Vector,
    NPerM=Slider(20000, range=0..100000),
    Global=Toggle(True))  # -> MatLabElementLoad; inputs LoadElementNo: list of Int32, ElePlanes: list, Direction: list, NPerM: list, Global: list of Boolean
# ---------- python_9: Python ----------
import rhinoscriptsyntax as rs
LEN=LoadElementNo
MatLabElementLoad="dL = zeros(nel,2);\n"
if not (len(LEN)==0 or len(Direction)==0 or len(NPerM)==0 or len(ElePlanes)==0 or len(Global)==0):
    #Repeat last element of shortest list
    eleLen = len(LEN)
    Direction.extend([Direction[-1]]*(eleLen-len(Direction)))
    NPerM.extend([NPerM[-1]]*(eleLen-len(NPerM)))
    Global.extend([Global[-1]]*(eleLen-len(Global)))
    Direction=Direction[:eleLen]
    NPerM=NPerM[:eleLen]
    Global=Global[:eleLen]
    vecX=[]
    vecY=[]
    vecOri=[]
    for i,dir in enumerate(Direction):
        #Unitize 2D vector
        vec=rs.VectorUnitize([dir[0],dir[1],0])
        if Global[i]:
            line=rs.AddLine((0,0,0),vec)
            #vec=rs.XformCPlaneToWorld((0,0,0),ElePlanes[LEN[i]])
            vpt=rs.XformWorldToCPlane(vec,ElePlanes[LEN[i]])
            opt=rs.XformWorldToCPlane((0,0,0),ElePlanes[LEN[i]])
            #print rs.EvaluatePlane(ElePlanes[LEN[i]],[0,0])
            vec=rs.VectorCreate(vpt,opt)
        print vec
        MLx="dL("+str(LEN[i]+1)+",:)=[1 "+str(vec[0]*NPerM[i])+"];\n"
        MLy="dL("+str(LEN[i]+1)+",:)=[2 "+str(vec[1]*NPerM[i])+"];\n"
        MatLabElementLoad=MatLabElementLoad+MLx+MLy
# ---------- end python_9 ----------
python_10 = PythonScript(
    SupportNodesNo=[Slider(3, range=0..10), Slider(5, range=0..10), Slider(0, range=0..10)],
    NodeDOFS=python_5.NodeDOFS,
    LockX=[toggle, toggle_2, toggle_3],
    LockY=[toggle, toggle_2, toggle_3],
    LockRot=Toggle(True))  # -> SupportDOFS, MatLabSupport; inputs SupportNodesNo: list of Int32, LockX: list of Boolean, LockY: list of Boolean, LockRot: list of Boolean
# ---------- python_10: Python ----------
listDOFS=NodeDOFS.replace("[","").replace("]","").replace(" ","").split(",")
SNN=SupportNodesNo
#Repeat last element of shortest list
if len(SNN)<>0 and len(LockX)<>0 and len(LockY)<>0 and len(LockRot)<>0:
    nodeLen = len(SNN)
    LockX.extend([LockX[-1]]*(nodeLen-len(LockX)))
    LockY.extend([LockY[-1]]*(nodeLen-len(LockY)))
    LockRot.extend([LockRot[-1]]*(nodeLen-len(LockRot)))
#Idiot sikring
LockX= LockX[:nodeLen]
LockY= LockY[:nodeLen]
LockRot= LockRot[:nodeLen]

SupportDOFS=[]
for i,snn in enumerate(SNN):
    dofsInd=range(snn*3,snn*3+3)
    if LockX[i]:
        SupportDOFS.append(listDOFS[dofsInd[0]])
    if LockY[i]:
        SupportDOFS.append(listDOFS[dofsInd[1]])
    if LockRot[i]:
        SupportDOFS.append(listDOFS[dofsInd[2]])
print SupportDOFS

MatLabSupport=""
for j,DOF in enumerate(SupportDOFS):
    MatLabSupport=MatLabSupport+"U("+str(j+1)+")="+DOF+";\n"
# ---------- end python_10 ----------

# ---- group: ToMatLab
python_11 = PythonScript(
    MatLabNodes=python_4.MatLabNodes,
    MatLabElements=python_4.MatLabElements,
    MatLabDOFS=python_5.MatLabDOFS,
    MatLabMaterial=python_8.MatLabMaterial,
    MatLabSupport=python_10.MatLabSupport,
    MatLabNodeLoads=python_7.MatLabNodeLoads,
    MatLabElementLoad=python_9,
    PlotScalingDeformation=Slider(5, range=0..5),
    PlotScalingForces=3e-05,
    run=Button(),
    refreshplots=Button())  # -> Info, MLstring, Displacements, ReactionForces, NormalForces, ShearForces, MomentForces, DeformationPlot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; inputs PlotScalingDeformation: list, PlotScalingForces: list, run: Boolean
# ---------- python_11: Python ----------
import os
import subprocess
import Grasshopper as GH
import rhinoscriptsyntax as rs

ghenv.Component.Params.Output[8].Hidden = True
ghenv.Component.Params.Output[9].Hidden = True
ghenv.Component.Params.Output[10].Hidden = True

def matlabIsInstalled():
    for path in os.environ["PATH"].split(";"):
        if os.path.isfile(os.path.join(path, "matlab.exe")):
            return True
    return False

def readPlotFile(filepath):
    file=open(filepath,"r")
    filestring=file.read()
    file.close()
    eleList=filestring.split("_")
    eleList=eleList[:-1]
    ptList=[]
    ThePlot=[]
    for ele in eleList:
        plotlines=[]
        plotpoints=[]
        if len(ele)>0:
            XYlist=ele.split("/")
            Xlist=XYlist[0].split(",")
            Ylist=XYlist[1].split(",")
        for i in range(len(Xlist)-1):
            plotpoints.append(rs.AddPoint(float(Xlist[i]),float(Ylist[i]),0))
        for i in range(len(plotpoints)-1):
            plotlines.append(rs.AddLine(plotpoints[i],plotpoints[i+1]))
        if len(plotlines)>1:
            ThePlot.append(rs.JoinCurves(plotlines))
        else:
            ThePlot=plotlines
    ThePlot=rs.ScaleObjects(ThePlot,(0,0,0),(1/rs.UnitScale(4),1/rs.UnitScale(4),1/rs.UnitScale(4)))
    return ThePlot

def readPlotSignFile(filepath):
    file=open(filepath,"r")
    filestring=file.read()
    file.close()
    eleList=filestring.split("_")
    plotpoints=[]
    for ele in eleList:
        XYlist=ele.split(",")
        if len(XYlist)>1:
            plotpoints.append(rs.AddPoint(float(XYlist[0]),float(XYlist[1]),0))
    ThePlot=rs.ScaleObjects(plotpoints,(0,0,0),(1/rs.UnitScale(4),1/rs.UnitScale(4),1/rs.UnitScale(4)))
    return ThePlot

def plusSign(position):
    pluspts=[[-0.02,0.125,0],[0.02,0.125,0],[0.02,0.02,0],[0.125,0.02,0],[0.125,-0.02,0],
    [0.02,-0.02,0],[0.02,-0.125,0],[-0.02,-0.125,0],[-0.02,-0.02,0],[-0.125,-0.02,0],
    [-0.125,0.02,0],[-0.02,0.02,0],[-0.02,0.125,0]]
    
    plusses=[]
    for posi in position:
        pluspos=[]
        for pluspt in pluspts:
            scaledpt=[pluspt[0]*(0.5/rs.UnitScale(4)),pluspt[1]*(0.5/rs.UnitScale(4))]
            xcoord = rs.PointCoordinates(posi)[0]+scaledpt[0]
            ycoord = rs.PointCoordinates(posi)[1]+scaledpt[1]
            pluspos.append(rs.AddPoint(xcoord,ycoord,0))
        plusses.append(rs.AddPolyline(pluspos))
    
    return plusses


UOfolder= GH.Folders.UserObjectFolders[0]+"LKplugin\\"

ML=open(UOfolder+"RammeLKpluginTemplate.m","r")
MLstring=ML.read()
ML.close()

MLstring = MLstring.replace("MatLabNodes",MatLabNodes)
MLstring = MLstring.replace("MatLabElements",MatLabElements)
MLstring = MLstring.replace("MatLabDOFS",MatLabDOFS)
MLstring = MLstring.replace("MatLabMaterial",MatLabMaterial)
MLstring = MLstring.replace("MatLabSupport",MatLabSupport)
MLstring = MLstring.replace("MatLabNodeLoads",MatLabNodeLoads)
MLstring = MLstring.replace("MatLabElementLoad",MatLabElementLoad)
MLstring = MLstring.replace("MatLabElementLoad",MatLabElementLoad)
MLstring = MLstring.replace("PlotScalingDeformation",str(PlotScalingDeformation[0]))
MLstring = MLstring.replace("PlotScalingForces",str(PlotScalingForces[0]))

tempFPath=UOfolder+"TempMLfile.m"

mFile=open(tempFPath,"w")
mFile.write(MLstring)
mFile.close()

resultfile=UOfolder+"result.txt"
deformationfile=UOfolder+"deformation.txt"
momentfile=UOfolder+"momentforces.txt"
normalfile=UOfolder+"normalforces.txt"
shearfile=UOfolder+"shearforces.txt"
momentsignfile=UOfolder+"momentsignforces.txt"
normalsignfile=UOfolder+"normalsignforces.txt"
shearsignfile=UOfolder+"shearsignforces.txt"
Info=[]

if matlabIsInstalled():
    if run:
        P=subprocess.Popen("matlab -nosplash -nodesktop -minimize -r \"run "+tempFPath+"\"")
else:
    Info.append("MatLab not installed")

if os.path.isfile(resultfile) and os.path.isfile(deformationfile):
    if True:
        result=open(resultfile,"r")
        resultstring=result.read()
        result.close()
        resList=resultstring.split(",")
        V=[]
        Ru=[]
        F1=[]
        F2=[]
        M=[]
        listlist=[V,Ru,F1,F2,M]
        listCount=0
        for res in resList:
            if res[:1]=="/":
                listCount+=1
                res=res.replace("/","")
            listlist[listCount].append(res)
        M=M[:-1]
        DeformationPlot=readPlotFile(deformationfile)
        MomentPlot=readPlotFile(momentfile)+plusSign(readPlotSignFile(momentsignfile))
        ShearPlot=readPlotFile(shearfile)+plusSign(readPlotSignFile(shearsignfile))
        NormalPlot=readPlotFile(normalfile)+plusSign(readPlotSignFile(normalsignfile))
    Displacements=V
    ReactionForces=Ru
    NormalForces=[]
    [NormalForces.append(str(F1[i])+", "+str(F1[i+5])) for i in range(int(len(F1)/2))]
    ShearForces=[]
    [ShearForces.append(str(F2[i])+", "+str(F2[i+5])) for i in range(int(len(F1)/2))]
    MomentForces=[]
    [MomentForces.append(str(M[i])+", "+str(M[i+5])) for i in range(int(len(F1)/2))]
else:
    Info.append("Deformation and resultsfile not found")
# ---------- end python_11 ----------

# ----
crv_7 = Curve(python_11.MomentPlot)
len = Length(Curve=crv_7)
panel_6 = Panel(python_11.ShearForces)

# ==== cluster Cluster
C = ClusterInput()
join = JoinCurves(Curves=C, Preserve=False)
item = ListItem(List=join, Index=Slider(0, range=0..100), Wrap=True)

explode = Explode(Curve=flatten(C), Recursive=True)  # -> Segments, Vertices
eval = EvaluateCurve(Curve=reparameterize(explode.Segments), Parameter=0.5)  # -> Point, Tangent, Angle
sort_pt = SortPoints(Points=flatten(eval.Point))  # -> Points, Indices
tstat = TreeStatistics(Tree=eval.Point)  # -> Paths, Length, Count
item_2 = ListItem(List=tstat.Paths, Index=sort_pt.Indices, Wrap=True)
branch = TreeBranch(Tree=explode.Segments, Path=item_2, MaintainPaths=False)
explode_2 = Explode(Curve=branch, Recursive=True)  # -> Segments, Vertices
sort_pt_2 = SortPoints(Points=flatten(explode_2.Vertices))  # -> Points, Indices
pdecon = Deconstruct(Point=sort_pt_2.Points)  # -> XComponent, YComponent, ZComponent
pt = ConstructPoint(XCoordinate=pdecon.XComponent, YCoordinate=pdecon.YComponent, ZCoordinate=0)
bbox = BoundingBox(Content=pt, Plane=PlaneXY(0, 0, 0), UnionBox=True)  # -> Box, Box_2
area = Area(Geometry=bbox.Box)  # -> Area, Centroid
division = Division(A=area.Area, B=1500)
cullpt = CullDuplicates(Points=pt, Tolerance=0.1, CullMode=3)  # -> Points, Indices, Valence
cp = ClosestPoint(Point=explode_2.Vertices, Cloud=cullpt.Points)  # -> ClosestPoint, CPIndex, Distance
eval_2 = EvaluateCurve(Curve=reparameterize(flatten(explode_2.Segments)), Parameter=0.5)  # -> Point, Tangent, Angle
item_3 = ListItem(List=cp.CPIndex, Index=0, Wrap=True)  # -> Item, Item1
points = PointList(Points=cullpt.Points, Size=division)
points_2 = PointList(Points=eval_2.Point, Size=division)
pt_2 = ConstructPoint(XCoordinate=item_3.Item, YCoordinate=item_3.Item1, ZCoordinate=0)  # -> flatten(Point)

python = PythonScript(incurves=join, keeporder=Toggle(False))  # -> out, b, sortedln; inputs incurves: list
# ---------- python: Python ----------
import rhinoscriptsyntax as rs

curves=[]
lines=[]

for crv in incurves:
    if rs.IsPolyline(crv) or rs.IsPolyCurve(crv):
        curves.extend(rs.ExplodeCurves(crv))
    else:
        curves.append(crv)

for curve in curves:
    lines.append(rs.AddLine(rs.CurveStartPoint(curve),rs.CurveEndPoint(curve)))

if not keeporder:
    points=[]
    indices=[]
    for line in lines:
        points.append(rs.CurveMidPoint(line))
    sortedpts=rs.SortPoints(points,True)
    for point in points:
        indices.append(sortedpts.index(point))
    sortin,sortedln = zip(*sorted(zip(indices, lines)))
# ---------- end python ----------
item_4 = ListItem(List=python.sortedln, Index=Slider(10, range=0..10), Wrap=True)
pline = PolyLine(Closed=False)
points_3 = PointList(Points=python.b, Size=Slider(2, range=0..10))
nodes = ClusterOutput(cullpt.Points)  # Node coordinates
topolist = ClusterOutput(pt_2)  # Point where x is index of element startpoint and y end point
