# Grasshopper definition thesis_example.gh (Grasshopper 0.9.76)
# Copyright: CN3

number_slider = Slider(4, range=0..10)
pt = ConstructPoint(XCoordinate=0, YCoordinate=number_slider, ZCoordinate=0)
pt_2 = ConstructPoint(XCoordinate=Slider(2, range=0..10), YCoordinate=number_slider, ZCoordinate=0)
pt_3 = ConstructPoint(XCoordinate=number_slider, YCoordinate=number_slider, ZCoordinate=0)
pt_4 = ConstructPoint(XCoordinate=number_slider, YCoordinate=0, ZCoordinate=0)
pline = PolyLine(Vertices=[pt, pt_2, pt_3, pt_4], Closed=False)
lstopology = DefineTopologyLsFEM(input_curves=pline, sort_elements=True, sort_nodes=Toggle(False), decimals=1)
panel = Panel("""0
3""")
lssupports = DefineSupportsLsFEM(femdata=lstopology, nodesindex=panel, lockx=True, locky=True, lockrotation=Toggle(False))
lsnodeloads = DefineNodeLoadsLsFEM(
    femdata=lssupports,
    optional_nodeindex=Slider(1, range=0..1),
    direction=Vector(0, -1, 0),
    load_size=10000,
    preview_scale=0.1)
lsmaterials = DefineMaterialsLsFEM(
    femdata=lsnodeloads,
    e_modulus="200000000000",
    section_area="0.003",
    moment_of_inertia="0.00002",
    optional_profile_name="unknown",
    optional_material_name="unknown")
toggle = BooleanToggle(True)
lswriteinputfile = WriteInputFileLsFEM(
    femdata=lsmaterials,
    plot_scaling_deformation=10,
    plot_scaling_forces=0.1,
    plot_divisions=20,
    optional_project_name="thesis_example",
    write_file=toggle)  # -> femdata_2, input_file_path
lsfemcalculation = RunFEMCalculationLsFEM(input_file=lswriteinputfile.input_file_path, run=toggle)
lsreadresultfile = ReadResultFileLsFEM(result_file_path=lsfemcalculation, plot_to_preview=0)  # -> displacements, deformationplot, reactionforces, normalforces, normalplot, shearforces, shearplot, bendingmoment, momentplot

# ==== cluster DefineTopologyLsFEM: Defines the topology of the the system.
decimals = ClusterInput()  # The number of decimals used for coordinates in meters.
input_curves = ClusterInput()  # The curves to generate the topology from, polylines or lines
sort_elements = ClusterInput()  # Sort elements euclidean (first x then y then z) from the midpoint.
sort_nodes = ClusterInput()  # Sort nodes euclidean (first x then y then z) from the midpoint.
crv = Curve(flatten(input_curves))
explode = Explode(Curve=crv, Recursive=True)  # -> Segments, flatten(Vertices)
int = Integer(decimals)
bool = Boolean(sort_elements)
bool_2 = Boolean(sort_nodes)
plfit = PlaneFit(Points=explode.Vertices)  # -> Plane, Deviation
deplane = DeconstructPlane(Plane=plfit.Plane)  # -> Origin, XAxis, YAxis, ZAxis
Z = UnitZ(Factor=1)
abs = Absolute(Value=deplane.ZAxis)
Z_2 = UnitZ(Factor=1)
txt = Text(abs)
txt_2 = Text(Z)
txt_3 = Text(Z_2)
merge = Merge(Data1=flatten(txt), Data2=txt_2)
item = ListItem(List=flatten(merge), Index=0, Wrap=True)
python = PythonScript(x=txt_3, y=item)  # -> out, a
# ---------- python: Python ----------
a=x==y
# ---------- end python ----------
python_2 = PythonScript(InputCurves=crv, sortElements=bool, sortNodes=bool_2, tolerance=int, plane=python.a)  # -> FEMdata, Elements, Nodes, ElementMid, NRange, ERange, TextSize; inputs InputCurves: list, sortElements: list, sortNodes: list, tolerance: list
# ---------- python_2: Python ----------
import sys
from Grasshopper.Folders import DefaultUserObjectFolder
if not DefaultUserObjectFolder+"Livestock\\lsFEM\\dependables" in sys.path:
    sys.path.insert(0,DefaultUserObjectFolder+"Livestock\\lsFEM\\dependables")
import livestockFEM_ghlib_v2 as ls
import Grasshopper.Kernel as gh

reload(ls)

owner = ghenv.Component.OnPingDocument().Owner

if not plane:
    owner.AddRuntimeMessage(gh.GH_RuntimeMessageLevel.Warning, "Your structure is not drawn in the XY-plane (top view)!. Please note the structure will be projected to the XY-plane (top view) draw your structure, so your result might not be right.")
try:
    FEMdata=ls.defineTopology(InputCurves,sortElements[0],sortNodes[0],tolerance[0])
    Elements,Nodes,ElementMid,NRange,ERange,TextSize=ls.previewTopology(FEMdata)
    FEMdata=ls.prettyJSON(FEMdata)
except:
    owner.AddRuntimeMessage(gh.GH_RuntimeMessageLevel.Warning, "Unable to define topology.")
# ---------- end python_2 ----------
txt_4 = Text(python_2.FEMdata)
dots = DotDisplay(Point=python_2.Nodes, Colour=ColourSwatch(SwatchColor=RGB(0, 0, 255)), Size=expr("x/20", python_2.TextSize))
femdata = ClusterOutput(txt_4)
tag = TextTag3D(Location=python_2.Nodes, Text=python_2.NRange, Size=python_2.TextSize, Colour=RGB(255, 0, 0), Justification=5)
tag_2 = TextTag3D(Location=python_2.ElementMid, Text=python_2.ERange, Size=python_2.TextSize, Colour=RGB(0, 0, 255), Justification=5)
preview = CustomPreview(Geometry=python_2.Elements, Shader=ColourSwatch(SwatchColor=RGB(0, 0, 255)))

# ==== cluster DefineSupportsLsFEM: Define the supports of the system.
lockx = ClusterInput()  # Lock displacement in x-direction.
locky = ClusterInput()  # Lock displacement in y-direction.
lockrotation = ClusterInput()  # Lock rotation in node (cantilevered).
nodesindex = ClusterInput()  # Index of nodes with support.
femdata = ClusterInput()
bool = Boolean(lockx)
bool_2 = Boolean(locky)
bool_3 = Boolean(lockrotation)
int = Integer(nodesindex)
txt = Text(femdata)
python = PythonScript(FEMdata=txt, NodesIndex=int, LockX=bool, LockY=bool_2, LockRotation=bool_3)  # -> FEMdata, pllines; inputs FEMdata: list, NodesIndex: list of Int32, LockX: list of Boolean, LockY: list of Boolean, LockRotation: list of Boolean
# ---------- python: Python ----------
import sys
from Grasshopper.Folders import DefaultUserObjectFolder
if not DefaultUserObjectFolder+"Livestock\\lsFEM\\dependables" in sys.path:
    sys.path.insert(0,DefaultUserObjectFolder+"Livestock\\lsFEM\\dependables")
import livestockFEM_ghlib_v2 as ls
import Grasshopper.Kernel as gh
import json

reload(ls)

owner = ghenv.Component.OnPingDocument().Owner

if len(FEMdata) != 0:
    FEMdata=json.loads(FEMdata[0])
    nCheck,_,NodesIndex,_ = ls.checkIndex(FEMdata,nodes=NodesIndex)
    if nCheck:
        owner.AddRuntimeMessage(gh.GH_RuntimeMessageLevel.Warning, "Node index not in the system, node index has been ignored.")
    if len(NodesIndex) == 0:
        NodesIndex,FEMdata,LockX,LockY,LockRotation=ls.supportGuess(FEMdata)
        owner.AddRuntimeMessage(gh.GH_RuntimeMessageLevel.Remark, "No node indices input, supports have been guessed")
    FEMdata=ls.defineSupports(NodesIndex,FEMdata,LockX,LockY,LockRotation)
    pllines=ls.previewSupports(FEMdata)
    FEMdata=ls.prettyJSON(FEMdata)
else:
    owner.AddRuntimeMessage(gh.GH_RuntimeMessageLevel.Warning, "Please input FEMdata.")
# ---------- end python ----------
crv = Curve(python.pllines)
boundary = BoundarySurfaces(Edges=crv)
txt_2 = Text(python.FEMdata)
preview = CustomPreview(Geometry=boundary, Shader=ColourSwatch(SwatchColor=RGBA(0, 0, 0, 70)))
femdata_2 = ClusterOutput(txt_2)

# ==== cluster DefineNodeLoadsLsFEM: Define Node Loads (Boundary loads) in the system.
femdata = ClusterInput()
optional_nodeindex = ClusterInput()  # Indices of nodes to add load to. If no input load will be applied to all nodes.
direction = ClusterInput()
load_size = ClusterInput()  # Load size in Newton.
preview_scale = ClusterInput()  # Scaling of the load preview.
txt = Text(femdata)
int = Integer(optional_nodeindex)
vec = Vector(direction)
num = Number(load_size)
num_2 = Number(preview_scale)
python = PythonScript(FEMdata=txt, NodeIndex=int, Direction=vec, LoadSize=num, PreviewScale=num_2)  # -> FEMdata, npoints, nvectors, radius; inputs FEMdata: list, NodeIndex: list, Direction: list of Vector3d, LoadSize: list, PreviewScale: list
# ---------- python: Python ----------
import sys
from Grasshopper.Folders import DefaultUserObjectFolder
if not DefaultUserObjectFolder+"Livestock\\lsFEM\\dependables" in sys.path:
    sys.path.insert(0,DefaultUserObjectFolder+"Livestock\\lsFEM\\dependables")
import livestockFEM_ghlib_v2 as ls
import Grasshopper.Kernel as gh
import json

reload(ls)

owner = ghenv.Component.OnPingDocument().Owner

if len(FEMdata)!=0:
    FEMdata=json.loads(FEMdata[0])
    nCheck,_,NodeIndex,_ = ls.checkIndex(FEMdata,nodes=NodeIndex)
    if nCheck:
        owner.AddRuntimeMessage(gh.GH_RuntimeMessageLevel.Warning, "Node index not in the system, node index has been ignored.")
    FEMdata=ls.defineNodLoad(FEMdata,NodeIndex,Direction,LoadSize)
    npoints,nvectors,radius=ls.previewNodLoads(FEMdata,PreviewScale[0])
    FEMdata=ls.prettyJSON(FEMdata)
else:
    owner.AddRuntimeMessage(gh.GH_RuntimeMessageLevel.Warning, "Please input FEMdata.")
# ---------- end python ----------
txt_2 = Text(python.FEMdata)
femdata_2 = ClusterOutput(txt_2)
cir = Circle(Plane=python.npoints, Radius=python.radius)
vdis = VectorDisplay(Anchor=python.npoints, Vector=python.nvectors)

# ==== cluster DefineMaterialsLsFEM: Defines the materials of the system.
femdata = ClusterInput()
section_area = ClusterInput()  # In model units. Default is 1320mm2 corresponding to an IPE120 profile.
moment_of_inertia = ClusterInput()  # Second/area moment of inertia in model units. In model units. Default is 3178000mm4 corresponding to an IPE120 profile.
optional_elementindex = ClusterInput()  # (Optional) Index of the element to define material for, if no input same material assigned to all elements.
e_modulus = ClusterInput()  # Elastic/Young's modulus of the element in Newton per m2.
optional_profile_name = ClusterInput()  # Name of the profile type
optional_material_name = ClusterInput()  # Name of the material
txt = Text(femdata)
int = Integer(optional_elementindex)
num = Number(e_modulus)
num_2 = Number(section_area)
num_3 = Number(moment_of_inertia)
txt_2 = Text(optional_profile_name)
txt_3 = Text(optional_material_name)
python = PythonScript(FEMdata=txt, ElementIndex=int, E=num, SectionArea=num_2, Inertia=num_3, proName=txt_2, matName=txt_3)  # -> Materials, FEMdata, TextSize; inputs FEMdata: list, ElementIndex: list of Int32, E: list, SectionArea: list, Inertia: list, proName: list, matName: list
# ---------- python: Python ----------
import sys
from Grasshopper.Folders import DefaultUserObjectFolder
if not DefaultUserObjectFolder+"Livestock\\lsFEM\\dependables" in sys.path:
    sys.path.insert(0,DefaultUserObjectFolder+"Livestock\\lsFEM\\dependables")
import livestockFEM_ghlib_v2 as ls
import Grasshopper.Kernel as gh
import json

reload(ls)

owner = ghenv.Component.OnPingDocument().Owner

if len(FEMdata)!=0:
    FEMdata=json.loads(FEMdata[0])
    _,eCheck,_,ElementIndex = ls.checkIndex(FEMdata,elements=ElementIndex)
    if eCheck:
        owner.AddRuntimeMessage(gh.GH_RuntimeMessageLevel.Warning, "Element index not in the system, element index has been ignored.")
    Materials,FEMdata,TextSize = ls.defineMaterials(ElementIndex,FEMdata,E,SectionArea,Inertia,proName,matName)
    FEMdata=ls.prettyJSON(FEMdata)
else:
    owner.AddRuntimeMessage(gh.GH_RuntimeMessageLevel.Warning, "Please input FEMdata.")
# ---------- end python ----------
lsgeometry = StringToGeometryLsFEM(femdata=python.FEMdata)  # -> element_lines, node_points, planes
eval = EvaluateCurve(Curve=reparameterize(lsgeometry.element_lines), Parameter=0.5)  # -> Point, Tangent, Angle
txt_4 = Text(python.FEMdata)
femdata_2 = ClusterOutput(txt_4)
pl_origin = PlaneOrigin(Base=lsgeometry.planes, Origin=eval.Point)
tag = TextTag3D(
    Location=pl_origin,
    Text=python.Materials,
    Size=python.TextSize,
    Colour=ColourSwatch(SwatchColor=RGB(0, 0, 0)),
    Justification=8)

# ==== cluster WriteInputFileLsFEM: Writes the input file for the FEM calculations
femdata = ClusterInput()
plot_scaling_deformation = ClusterInput()
plot_scaling_forces = ClusterInput()
plot_divisions = ClusterInput()  # Number of subdivisions to calculate and plotting forces.
optional_project_name = ClusterInput()
optional_folder_path = ClusterInput()
write_file = ClusterInput()  # Write Input File
txt = Text(optional_project_name)
txt_2 = Text(optional_folder_path)
bool = Boolean(write_file)
num = Number(plot_scaling_deformation)
num_2 = Number(plot_scaling_forces)
int = Integer(plot_divisions)
txt_3 = Text(femdata)
cpython_fem = WriteRunPlotCPython(
    FEMdata=txt_3,
    PlotScalingDeformation=num,
    PlotScalingForces=num_2,
    PlotDivisions=int,
    projectName=txt,
    folder=txt_2,
    Run=bool)  # -> FEMdata, input_file, plpoints, pllines, vectors, pllinessup, Materials, textSize; inputs FEMdata: list, PlotScalingDeformation: list, PlotScalingForces: list, PlotDivisions: list of Int32, projectName: list, folder: list, Run: list of Boolean
# ---------- cpython_fem: Python ----------
import sys
from Grasshopper.Folders import DefaultUserObjectFolder
if not DefaultUserObjectFolder+"Livestock\\lsFEM\\dependables" in sys.path:
    sys.path.insert(0,DefaultUserObjectFolder+"Livestock\\lsFEM\\dependables")
import livestockFEM_ghlib_v2 as ls
import Grasshopper.Kernel as gh
import json

reload(ls)

owner = ghenv.Component.OnPingDocument().Owner

if len(FEMdata) == 0 and Run[0]:
    owner = ghenv.Component.OnPingDocument().Owner
    owner.AddRuntimeMessage(gh.GH_RuntimeMessageLevel.Warning, "Not enough inputs")
else:
    input_file=[]
    if Run[0]:
        FEMdata=json.loads(FEMdata[0])
        input_file,FEMdata,eleLoadPreview,supportPreview,materialPreview = ls.writeInputFile(FEMdata,PlotScalingDeformation[0],PlotScalingForces[0],PlotDivisions[0],projectName,folder)
        FEMdata=ls.prettyJSON(FEMdata)
        owner = ghenv.Component.OnPingDocument().Owner
        if len(input_file)==0:
            owner.AddRuntimeMessage(gh.GH_RuntimeMessageLevel.Warning, "Something went wrong, please try another folder. ")
        else:
            if len(supportPreview)!=0:
                owner.AddRuntimeMessage(gh.GH_RuntimeMessageLevel.Remark, "No supports has been defined for the system. Guessed supports has been added.")
                print(supportPreview)
                pllinessup = supportPreview
            if len(eleLoadPreview)!=0:
                owner.AddRuntimeMessage(gh.GH_RuntimeMessageLevel.Remark, "No loads has been defined for the system. The deadload of the system with IPE120/S235 elements has been added.")
                plpoints,pllines,vectors = eleLoadPreview
            if len(materialPreview)!=0:
                owner.AddRuntimeMessage(gh.GH_RuntimeMessageLevel.Remark, "There was elements with no material defined. The material parameters for IPE120/S235 elements has been added for these.")
                Materials,textSize = materialPreview
# ---------- end cpython_fem ----------
lsgeometry = StringToGeometryLsFEM(femdata=cpython_fem.FEMdata)  # -> element_lines, node_points, planes
path = FilePath(cpython_fem.input_file)
eval = EvaluateCurve(Curve=reparameterize(lsgeometry.element_lines), Parameter=0.5)  # -> Point, Tangent, Angle
txt_4 = Text(cpython_fem.FEMdata)
crv = Curve(cpython_fem.pllinessup)
boundary = BoundarySurfaces(Edges=crv)
pl_origin = PlaneOrigin(Base=lsgeometry.planes, Origin=eval.Point)
crv_2 = Curve(cpython_fem.pllines)
vdis = VectorDisplay(Anchor=cpython_fem.plpoints, Vector=cpython_fem.vectors)
femdata_2 = ClusterOutput(txt_4)
input_file_path = ClusterOutput(path)
tag = TextTag3D(Location=pl_origin, Text=cpython_fem.Materials, Size=cpython_fem.textSize, Justification=8)
preview = CustomPreview(Geometry=boundary, Shader=ColourSwatch(SwatchColor=RGBA(0, 0, 0, 70)))

# ==== cluster RunFEMCalculationLsFEM: Runs the finite element calculations. Requires CPython with NumPy installed.
optional_python_executable = ClusterInput()  # Path to CPython executable. Only neccessary if windows cannot find Python.
input_file = ClusterInput()
run = ClusterInput()
bool = Boolean(run)
path = FilePath(optional_python_executable)
path_2 = FilePath(input_file)
python = PythonScript(InputFile=path_2, PythonExe=path, Run=bool)  # -> ResultFile; inputs InputFile: list, PythonExe: list, Run: list of Boolean
# ---------- python: Python ----------
import sys
from Grasshopper.Folders import DefaultUserObjectFolder
uoFolder=DefaultUserObjectFolder+"Livestock\\lsFEM\\dependables"
if not uoFolder in sys.path:
    sys.path.insert(0,uoFolder)
import livestockFEM_ghlib_v2 as ls
import Grasshopper.Kernel as gh
import json
import os

reload(ls)

ResultFile=[]

if len(PythonExe)==0:
    PythonExe=[None]

if len(InputFile)!=0 and Run[0]:
    owner = ghenv.Component.OnPingDocument().Owner
    if not os.path.isfile(InputFile[0]):
        owner.AddRuntimeMessage(gh.GH_RuntimeMessageLevel.Warning, InputFile+" does not exist.")
    else:
        ResultFile,success= ls.run_template(uoFolder+"\\livestockFEM_v2.py",InputFile[0],PythonExe[0])
        resFile=open(ResultFile,"r")
        with open(ResultFile) as jsonfile:
            resDict = json.load(jsonfile)
        resDict = ls.prettyJSON(resDict)
        if not success:
            if PythonExe[0] is None:
                owner.AddRuntimeMessage(gh.GH_RuntimeMessageLevel.Warning, "Windows could not find Python, please the path to Python execuable.")
            else:
                owner.AddRuntimeMessage(gh.GH_RuntimeMessageLevel.Warning, "Python path not working please, check your path or remove Python path from inputs.")
elif Run[0]:
    owner = ghenv.Component.OnPingDocument().Owner
    owner.AddRuntimeMessage(gh.GH_RuntimeMessageLevel.Warning, "Please input path to inputfile.")
# ---------- end python ----------
path_3 = FilePath(python)
result_file = ClusterOutput(path_3)

# ==== cluster ReadResultFileLsFEM: Reads the result file from the FEM calculations.
plot_to_preview = ClusterInput()  # 0 = Deformation, 1 = Normal Forces, 2 = Shear Forces, 3 = Bending Moments
result_file_path = ClusterInput()
path = FilePath(result_file_path)
int = Integer(plot_to_preview)
cpython_fem = WriteRunPlotCPython(result_file=path)  # -> Displacements, DeformationPlot, defColor, ReactionForces, NormalForces, NormalPlot, norColor, ShearForces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; inputs result_file: list
#   port result_file: Python string for defining the nodes
# ---------- cpython_fem: Python ----------
import sys
from Grasshopper.Folders import DefaultUserObjectFolder
if not DefaultUserObjectFolder+"Livestock\\lsFEM\\dependables" in sys.path:
    sys.path.insert(0,DefaultUserObjectFolder+"Livestock\\lsFEM\\dependables")
import livestockFEM_ghlib_v2 as ls
import Grasshopper.Kernel as gh
import json

reload(ls)

#Hide All but Deformation plot
for op in ghenv.Component.Params.Output:
    op.Hidden=True

owner = ghenv.Component.OnPingDocument().Owner
if len(result_file)!=0:
    Displacements, DeformationPlot, defColor, ReactionForces, NormalForces, NormalPlot, norColor, ShearForces, ShearPlot, sheColor,MomentForces,MomentPlot, momColor, Plus, tooLarge=ls.readResults(result_file[0])
    if bool(tooLarge):
        owner.AddRuntimeMessage(gh.GH_RuntimeMessageLevel.Warning, "Deformations are too large to plot, please check that at least one of your supports are locked in the x-direction and one is locked in the y-direction.")
else:
    owner.AddRuntimeMessage(gh.GH_RuntimeMessageLevel.Warning, "Result File can't be read!")
# ---------- end cpython_fem ----------
python = PythonScript(x=int)  # -> a; inputs x: list of Int32
# ---------- python: Python ----------
a=min(x[0],3)
# ---------- end python ----------
filter = StreamFilter(
    Gate=python,
    Stream0=cpython_fem.defColor,
    Stream1=cpython_fem.norColor,
    Stream2=cpython_fem.sheColor,
    Stream3=cpython_fem.momColor)
filter_2 = StreamFilter(
    Gate=python,
    Stream0=cpython_fem.DeformationPlot,
    Stream1=cpython_fem.NormalPlot,
    Stream2=cpython_fem.ShearPlot,
    Stream3=cpython_fem.MomentPlot)
num = Number(cpython_fem.Displacements)
crv = Curve(cpython_fem.DeformationPlot)
num_2 = Number(cpython_fem.ReactionForces)
num_3 = Number(cpython_fem.NormalForces)
crv_2 = Curve(cpython_fem.NormalPlot)
num_4 = Number(cpython_fem.ShearForces)
crv_3 = Curve(cpython_fem.ShearPlot)
num_5 = Number(cpython_fem.MomentForces)
crv_4 = Curve(cpython_fem.MomentPlot)
join = JoinCurves(Curves=crv, Preserve=False)
join_2 = JoinCurves(Curves=crv_2, Preserve=False)
join_3 = JoinCurves(Curves=crv_3, Preserve=False)
join_4 = JoinCurves(Curves=crv_4, Preserve=False)
end = EndPoints(Curve=join_4)  # -> Start, End
ln = Line(StartPoint=end.Start, EndPoint=end.End)
crv_5 = Curve(filter_2)
num_6 = Number(filter)
crv_6 = Curve(join)
crv_7 = Curve(join_2)
crv_8 = Curve(join_3)
crv_9 = Curve(join_4)
divide = DivideCurve(Curve=ln, Count=11, Kinks=False)  # -> Points, Tangents, Parameters
gradient = Gradient(
    LowerLimit=0,
    UpperLimit=1,
    Parameter=num_6,
    stops=[0: RGB(0, 0, 255), 0.245: RGB(0, 255, 255), 0.499: RGB(0, 200, 0), 0.746: RGB(255, 255, 0), 1: RGB(255, 0, 0)])
displacements = ClusterOutput(num)  # Displacements corresponding to the degrees of freedom in model units
deformationplot = ClusterOutput(crv_6)
reactionforces = ClusterOutput(num_2)  # In Newton
normalforces = ClusterOutput(num_3)  # In Newton/m2 (Pascal)
normalplot = ClusterOutput(crv_7)
shearforces = ClusterOutput(num_4)  # In Newton/m2 (Pascal)
shearplot = ClusterOutput(crv_8)  # Lines representing the size of the of forces.
bendingmoment = ClusterOutput(num_5)  # In Newtonmeter
momentplot = ClusterOutput(crv_9)  # Bending moments in the structure
shatter = Shatter(Curve=ln, Parameters=divide.Parameters)
panel = Panel(crv_5)
crv_10 = Curve(cpython_fem.Plus)
culln = CullNth(List=shatter, CullFrequency=2)
boundary = BoundarySurfaces(Edges=crv_10)
swatch = ColourSwatch(SwatchColor=RGBA(0, 0, 0, 70))
preview = CustomPreview(Geometry=simplify(crv_5), Shader=simplify(gradient))
preview_2 = CustomPreview(Geometry=simplify(culln), Shader=simplify(swatch))
preview_3 = CustomPreview(Geometry=boundary, Shader=swatch)
panel_2 = Panel(num_6)

# ==== cluster StringToGeometryLsFEM: Generates geometry from the python text.
femdata = ClusterInput()
txt = Text(femdata)
python = PythonScript(FEMdata=txt)  # -> Elements, Nodes, Planes
# ---------- python: Python ----------
import sys
if not "C:\livestock3d\data\livestockFEM" in sys.path:
    sys.path.insert(0,r"C:\livestock3d\data\livestockFEM")
import livestockFEM_ghlib_v2 as ls
import Grasshopper.Kernel as gh
import json

reload(ls)

if not FEMdata is None:
    FEMdata=json.loads(FEMdata)
    Elements,Nodes,Planes=ls.OriGeo(FEMdata)
else:
    ghenv.Component.AddRuntimeMessage(gh.GH_RuntimeMessageLevel.Warning, "Not enough inputs")
    Elements=[]
    Nodes=[]
# ---------- end python ----------
pln = Plane(python.Planes)
pt = Point(python.Nodes)
crv = Curve(python.Elements)
element_lines = ClusterOutput(crv)
planes = ClusterOutput(pln)
node_points = ClusterOutput(pt)
